% Simulink data dictionary testmodel.sldd

wmp_app_code_day = oe.Signal(Accuracy="1", Scale="1", Offset="0", StorageClass="ExportedGlobal", DataType="uint16", Min=0, Max=0)  % Day the application code was built.
wmp_app_code_major_ver = oe.Signal(Accuracy="1", Scale="1", Offset="0", StorageClass="ExportedGlobal", DataType="uint16", Min=0, Max=0)  % Major version of the application code.
wmp_app_code_minor_ver = oe.Signal(Accuracy="1", Scale="1", Offset="0", StorageClass="ExportedGlobal", DataType="uint16", Min=0, Max=0)  % Minor version of the application code.
wmp_app_code_month = oe.Signal(Accuracy="1", Scale="1", Offset="0", StorageClass="ExportedGlobal", DataType="uint16", Min=0, Max=0)  % Month the application code was built.
wmp_app_code_subminor_ver = oe.Signal(Accuracy="1", Scale="1", Offset="0", StorageClass="ExportedGlobal", DataType="uint16", Min=0, Max=0)  % Sub-minor version of the application code.
wmp_app_code_year = oe.Signal(Accuracy="1", Scale="1", Offset="0", StorageClass="ExportedGlobal", DataType="uint16", Min=0, Max=0)  % Year the application code was built.
wmp_boot_code_day = oe.Signal(Accuracy="1", Scale="1", Offset="0", StorageClass="ExportedGlobal", DataType="uint16", Min=0, Max=0)  % Day the boot code was built.
wmp_boot_code_major_ver = oe.Signal(Accuracy="1", Scale="1", Offset="0", StorageClass="ExportedGlobal", DataType="uint16", Min=0, Max=0)  % Major version of the boot code.
wmp_boot_code_minor_ver = oe.Signal(Accuracy="1", Scale="1", Offset="0", StorageClass="ExportedGlobal", DataType="uint16", Min=0, Max=0)  % Minor version of the boot code.
wmp_boot_code_month = oe.Signal(Accuracy="1", Scale="1", Offset="0", StorageClass="ExportedGlobal", DataType="uint16", Min=0, Max=0)  % Month the boot code was built.
wmp_boot_code_subminor_ver = oe.Signal(Accuracy="1", Scale="1", Offset="0", StorageClass="ExportedGlobal", DataType="uint16", Min=0, Max=0)  % Sub-minor version of the boot code.
wmp_boot_code_year = oe.Signal(Accuracy="1", Scale="1", Offset="0", StorageClass="ExportedGlobal", DataType="uint16", Min=0, Max=0)  % Year the boot code was built.
wmp_cpu_loading = oe.Signal(Accuracy="1", Scale="1", Offset="0", StorageClass="ExportedGlobal", DataType="uint8", Min=0, Max=0, Unit="%")  % CPU loading seen in last 50ms
wmp_cpu_loading_max = oe.Signal(Accuracy="1", Scale="1", Offset="0", StorageClass="ExportedGlobal", DataType="uint8", Min=0, Max=0, Unit="%")  % Maximum CPU loading seen in any 50ms period
wmp_platform_code_day = oe.Signal(Accuracy="1", Scale="1", Offset="0", StorageClass="ExportedGlobal", DataType="uint16", Min=0, Max=0)  % Day the platform library code was built.
wmp_platform_code_major_ver = oe.Signal(Accuracy="1", Scale="1", Offset="0", StorageClass="ExportedGlobal", DataType="uint16", Min=0, Max=0)  % Major version of the platform library code.
wmp_platform_code_minor_ver = oe.Signal(Accuracy="1", Scale="1", Offset="0", StorageClass="ExportedGlobal", DataType="uint16", Min=0, Max=0)  % Minor version of the platform library code.
wmp_platform_code_month = oe.Signal(Accuracy="1", Scale="1", Offset="0", StorageClass="ExportedGlobal", DataType="uint16", Min=0, Max=0)  % Month the platform library code was built.
wmp_platform_code_subminor_ver = oe.Signal(Accuracy="1", Scale="1", Offset="0", StorageClass="ExportedGlobal", DataType="uint16", Min=0, Max=0)  % Sub-minor version of the platform library code.
wmp_platform_code_year = oe.Signal(Accuracy="1", Scale="1", Offset="0", StorageClass="ExportedGlobal", DataType="uint16", Min=0, Max=0)  % Year the platform library code was built.
wmp_prg_code_day = oe.Signal(Accuracy="1", Scale="1", Offset="0", StorageClass="ExportedGlobal", DataType="uint16", Min=0, Max=0)  % Day the reprogramming code was built.
wmp_prg_code_major_ver = oe.Signal(Accuracy="1", Scale="1", Offset="0", StorageClass="ExportedGlobal", DataType="uint16", Min=0, Max=0)  % Major version of the reprogramming code.
wmp_prg_code_minor_ver = oe.Signal(Accuracy="1", Scale="1", Offset="0", StorageClass="ExportedGlobal", DataType="uint16", Min=0, Max=0)  % Minor version of the reprogramming code.
wmp_prg_code_month = oe.Signal(Accuracy="1", Scale="1", Offset="0", StorageClass="ExportedGlobal", DataType="uint16", Min=0, Max=0)  % Month the reprogramming code was built.
wmp_prg_code_subminor_ver = oe.Signal(Accuracy="1", Scale="1", Offset="0", StorageClass="ExportedGlobal", DataType="uint16", Min=0, Max=0)  % Sub-minor version of the reprogramming code.
wmp_prg_code_year = oe.Signal(Accuracy="1", Scale="1", Offset="0", StorageClass="ExportedGlobal", DataType="uint16", Min=0, Max=0)  % Year the reprogramming code was built.
wmp_signal = oe.Signal(Accuracy="0.01", Scale="1", Offset="0", StorageClass="ExportedGlobal", DataType="double", Min=0, Max=0, Unit="degC")  % Replace this with a useful comment.
wmp_stack_used = oe.Signal(Accuracy="1", Scale="1", Offset="0", StorageClass="ExportedGlobal", DataType="uint32", Min=0, Max=0, Unit="bytes")  % Amount of used stack
wmp_task_duration_1s = oe.Signal(Accuracy="1", Scale="1", Offset="0", StorageClass="ExportedGlobal", DataType="uint32", Min=0, Max=0, Unit="microseconds")  % Duration of 1s task (last measured valued)
wmp_task_duration_1s_max = oe.Signal(Accuracy="1", Scale="1", Offset="0", StorageClass="ExportedGlobal", DataType="uint32", Min=0, Max=0, Unit="microseconds")  % Duration of 1s task (maximum since power up)
wmpc_param = oe.Parameter(0, Accuracy="0.01", Scale="1", Offset="0", StorageClass="ExportedGlobal", TypeQualifier="OE_CAL", Min=0, Max=0, Unit="kPa")  % Replace this with a useful comment.